# Grasshopper definition team_01_working.gh (Grasshopper 1.0.8)
# plug-ins: Swiftlet

# ----
# Connect MCP Tools to Decall and Update All Clusters
button = Button()
# IF SOMETHING IS NOT
# WORKING PRESS THIS
# BUTTON FIRST
toggle = BooleanToggle(True)
connect_mcp_tools_to_decall = CSharpScript(nickname_From="Central MCP Server", nickname_To="Central DeCall", connect=button)  # -> out; inputs nickname_From: String, nickname_To: String, connect: Boolean
# ---------- connect_mcp_tools_to_decall: C# ----------
using System;
using System.Linq;
using Grasshopper;
using Grasshopper.Kernel;

public class Script_Instance : GH_ScriptInstance
{
    private void RunScript(string nickname_From, string nickname_To, bool connect)
    {
        if (!connect) return;
        Console.Write($"Attempting to connect outputs from '{nickname_From}' to '{nickname_To}'...");

        var ghDoc = Instances.ActiveCanvas?.Document;
        if (ghDoc == null) return;

        var compFrom = ghDoc.Objects
            .OfType<IGH_Component>()
            .FirstOrDefault(o => o.NickName == nickname_From);

        var compTo = ghDoc.Objects
            .OfType<IGH_Param>()
            .FirstOrDefault(o => o.NickName == nickname_To);

        if (compFrom != null && compTo != null)
        {
            ghDoc.ScheduleSolution(5, doc => Connect(doc, compFrom, compTo));
        }
    }

    // <Custom additional code> 
    private void Connect(GH_Document doc, IGH_Component compFrom, IGH_Param compTo)
    {
        if (compFrom == null || compTo == null) return;

        foreach (IGH_Param param in compFrom.Params.Output)
        {
            compTo.AddSource(param);
        }
    }
}
# ---------- end connect_mcp_tools_to_decall ----------
update_all_clusters = CSharpScript(update=button, recursive=toggle)  # -> out, A; inputs update: Boolean, recursive: Boolean, passwords: list of String, localPath: String
# ---------- update_all_clusters: C# ----------
using System;
using System.Collections;
using System.Collections.Generic;

using Rhino;
using Rhino.Geometry;

using Grasshopper;
using Grasshopper.Kernel;
using Grasshopper.Kernel.Data;
using Grasshopper.Kernel.Types;
using System.Windows.Forms;
using System.Linq;
/// <summary>
/// This class will be instantiated on demand by the Script component.
/// </summary>
public class Script_Instance : GH_ScriptInstance
{
  /// <summary>Print a String to the [Out] Parameter of the Script component.</summary>
  /// <param name="text">String to print.</param>
  private void Print(string text) { /* Implementation hidden. */ }
  /// <summary>Print a formatted String to the [Out] Parameter of the Script component.</summary>
  /// <param name="format">String format.</param>
  /// <param name="args">Formatting parameters.</param>
  private void Print(string format, params object[] args) { /* Implementation hidden. */ }
  /// <summary>Print useful information about an object instance to the [Out] Parameter of the Script component. </summary>
  /// <param name="obj">Object instance to parse.</param>
  private void Reflect(object obj) { /* Implementation hidden. */ }
  /// <summary>Print the signatures of all the overloads of a specific method to the [Out] Parameter of the Script component. </summary>
  /// <param name="obj">Object instance to parse.</param>
  private void Reflect(object obj, string method_name) { /* Implementation hidden. */ }

  /// <summary>Gets the current Rhino document.</summary>
  private readonly RhinoDoc RhinoDocument;
  /// <summary>Gets the Grasshopper document that owns this script.</summary>
  private readonly GH_Document GrasshopperDocument;
  /// <summary>Gets the Grasshopper script component that owns this script.</summary>
  private readonly IGH_Component Component;
  /// <summary>
  /// Gets the current iteration count. The first call to RunScript() is associated with Iteration==0.
  /// Any subsequent call within the same solution will increment the Iteration count.
  /// </summary>
  private readonly int Iteration;

  /// <summary>
  /// This procedure contains the user code. Input parameters are provided as regular arguments,
  /// Output parameters as ref arguments. You don't have to assign output parameters,
  /// they will have a default value.
  /// </summary>
  private void RunScript(
		bool update,
		bool recursive,
		List<string> passwords,
		string localPath,
		ref object A)
  {

    A = updateLog;
    if (update)
    {
      updateLog = new List<string>();
      _passwords = passwords;
      UpdateClusters(GrasshopperDocument, recursive, localPath);
    }

  }

  // <Custom additional code> 
  List<string> updateLog;
  List<String> _passwords;

  void UpdateClusters (GH_Document ghDoc, bool recursive, string localPath)
  {
    foreach (var obj in ghDoc.Objects)
    {
      var cluster = obj as Grasshopper.Kernel.Special.GH_Cluster;
      if (cluster != null)
      {
        var clusterPath = cluster.FilePath;
        if (!string.IsNullOrEmpty(clusterPath))
        {
          if (cluster.Synchronisation == Grasshopper.Kernel.Special.GH_Synchronisation.OutOfDate)
          {
            cluster.CreateFromFilePath(clusterPath);
            updateLog.Add("Updated: " + clusterPath);
          }
          else if (cluster.Synchronisation == Grasshopper.Kernel.Special.GH_Synchronisation.MissingReference)
          {
            string newPath = ReplacePath(localPath, clusterPath);
            if (!string.IsNullOrEmpty(newPath))
            {
              cluster.CreateFromFilePath(newPath);
              updateLog.Add("Replaced and updated: " + newPath);
            }
            else
            {
              updateLog.Add("Missing reference: " + clusterPath);
            }

          }
        }

        //Update recursively
        if (recursive)
        {
          GH_Document clusterDoc = GetClusterDoc(cluster);
          if (clusterDoc != null)
            UpdateClusters(clusterDoc, recursive, localPath);
        }
      }
    }
  }

  GH_Document GetClusterDoc(Grasshopper.Kernel.Special.GH_Cluster cluster)
  {
    //no pass needed
    var doc = cluster.Document(string.Empty);
    if (doc != null)
      return doc;

    //try passwords
    if (_passwords != null && _passwords.Any())
    {
      foreach (var pass in _passwords)
      {
        doc = cluster.Document(pass);
        if (doc != null)
          return doc;
      }
    }

    return null;
  }

  string ReplacePath(string localPath, string missingPath)
  {
    if (String.IsNullOrEmpty(missingPath) || string.IsNullOrEmpty(localPath))
      return null;
    else
    {
      string lastLocalPart = localPath.Split('\\').Last();
      string[] parts = missingPath.Split('\\');
      if (parts.Contains(lastLocalPart))
      {
        int i = Array.IndexOf(parts, lastLocalPart);
        string clusterPath = String.Join("\\", parts.Skip(i + 1));
        string result = String.Join("\\", localPath, clusterPath);
        return result;
      }
      else
        return null;
    }
  }
  // </Custom additional code> 
}
# ---------- end update_all_clusters ----------
panel = Panel(connect_mcp_tools_to_decall)

team_01_definition_cluster = Team01DefinitionCluster()
c_script = CSharpScript()  # -> out, availablePort
# ---------- c_script: C# ----------
// Grasshopper Script Instance
// This script finds an available port on the local machine.
#region Usings
using System;
using System.Linq;
using System.Collections;
using System.Collections.Generic;
using System.Drawing;
using System.Net;
using System.Net.Sockets;

using Rhino;
using Rhino.Geometry;

using Grasshopper;
using Grasshopper.Kernel;
using Grasshopper.Kernel.Data;
using Grasshopper.Kernel.Types;
#endregion

public class Script_Instance : GH_ScriptInstance
{
    #region Notes
    /* 
      Members:
        RhinoDoc RhinoDocument
        GH_Document GrasshopperDocument
        IGH_Component Component
        int Iteration

      Methods (Virtual & overridable):
        Print(string text)
        Print(string format, params object[] args)
        Reflect(object obj)
        Reflect(object obj, string method_name)
    */
    #endregion

    private void RunScript(object start, object end, ref object availablePort)
    {
        // Use default values if parameters are not provided
        int startPort = (start != null && int.TryParse(start.ToString(), out int s)) ? s : 3001;
        int endPort = (end != null && int.TryParse(end.ToString(), out int e)) ? e : 3100;

        // Find an available port in the specified range
        try
        {
            availablePort = FindAvailablePortInRange(startPort, endPort);
            Print($"Available port found: {availablePort}");
        }
        catch (Exception ex)
        {
            Print($"Error: {ex.Message}");
            availablePort = null;
        }
    }

    /// <summary>
    /// Checks if a local TCP port is available for binding (i.e., not in use).
    /// Returns True if available, False otherwise.
    /// </summary>
    private bool IsPortAvailableForBind(int port)
    {
        try
        {
            // Create a new TCP socket
            using (Socket socket = new Socket(AddressFamily.InterNetwork, SocketType.Stream, ProtocolType.Tcp))
            {
                // Try to bind to the port on all interfaces (0.0.0.0)
                socket.Bind(new IPEndPoint(IPAddress.Any, port));
                // If successful, the socket is closed by the using statement and return True
                return true;
            }
        }
        catch (SocketException)
        {
            // If binding fails, it means the port is already in use
            return false;
        }
    }

    /// <summary>
    /// Finds an available port by letting the OS assign one.
    /// </summary>
    private int FindAvailablePort()
    {
        Socket socket = new Socket(AddressFamily.InterNetwork, SocketType.Stream, ProtocolType.Tcp);
        socket.Bind(new IPEndPoint(IPAddress.Any, 0)); // Bind to an available port assigned by the OS
        int availablePort = ((IPEndPoint)socket.LocalEndPoint).Port; // Get the assigned port number
        socket.Close(); // Close the socket
        return availablePort;
    }

    /// <summary>
    /// Finds the first available port in a given range.
    /// </summary>
    private int FindAvailablePortInRange(int start = 3001, int end = 3100)
    {
        for (int port = start; port <= end; port++)
        {
            if (IsPortAvailableForBind(port))
                return port;
        }
        throw new Exception($"No available ports found in the range {start}-{end}.");
    }
}
# ---------- end c_script ----------
central_mcp_server = MCPServer(Port=c_script.availablePort, Tools=team_01_definition_cluster, ServerName="Swiftlet")  # -> Compute_volume_of_sphere, Compute_area_of_sphere, Delete_room_01, Add_window_01, Compute_volume_of_cone, Compute_volume_of_box, Classify_element_permanence
panel_2 = Panel(c_script.availablePort)
get_tool_names = CSharpScript(x=team_01_definition_cluster)  # -> flatten(out)
# ---------- get_tool_names: C# ----------
// Grasshopper Script Instance
#region Usings
using System;
using System.Linq;
using System.Collections;
using System.Collections.Generic;
using System.Drawing;

using Rhino;
using Rhino.Geometry;

using Grasshopper;
using Grasshopper.Kernel;
using Grasshopper.Kernel.Data;
using Grasshopper.Kernel.Types;
#endregion

public class Script_Instance : GH_ScriptInstance
{
    #region Notes
    /* 
      Members:
        RhinoDoc RhinoDocument
        GH_Document GrasshopperDocument
        IGH_Component Component
        int Iteration

      Methods (Virtual & overridable):
        Print(string text)
        Print(string format, params object[] args)
        Reflect(object obj)
        Reflect(object obj, string method_name)
    */
    #endregion

    private void RunScript(object x)
    {
        dynamic dynamicX = x;
        Console.Write(dynamicX.Name);
    }
}
# ---------- end get_tool_names ----------
central_decall = Data([central_mcp_server.Compute_volume_of_sphere, central_mcp_server.Compute_area_of_sphere, central_mcp_server.Delete_room_01, central_mcp_server.Add_window_01, central_mcp_server.Compute_volume_of_cone, central_mcp_server.Compute_volume_of_box, central_mcp_server.Classify_element_permanence])
clean = CleanTree(RemoveNulls=True, RemoveInvalid=True, RemoveEmpty=False, Tree=central_decall)
team_01_result_cluster = Team01ResultCluster(tool_call_request=clean)  # -> tool_names_3, tool_call_success

# ----
# Tool Names from the Results Clusters
# Tool Names from the Definition Clusters
# These Two Clusters should be EXACTLY THE SAME
panel_3 = Panel(get_tool_names)
panel_4 = Panel(team_01_result_cluster.tool_names_3)

rec = DataRecorder(clean, DataLimit=-10, RecordData=True)
rec_2 = DataRecorder(team_01_result_cluster.tool_call_success, DataLimit=-10, RecordData=True)

# ---- group: Request Parameters
decall = DeconstructToolCall(Request=clean)  # -> Request, Tool, Arguments
rjo = ReadJSONObject(JObject=decall.Arguments)  # -> Keys, JTokens
# Debug: Check request input data
panel_5 = Panel("room_name")
tmatch = MatchText(Text=rjo.Keys, Pattern=panel_5, Case=True)
tmatch_2 = MatchText(Text=rjo.Keys, Pattern="layout_json", Case=True)
dispatch = Dispatch(List=rjo.JTokens, DispatchPattern=tmatch)  # -> ListA, ListB
dispatch_2 = Dispatch(List=rjo.JTokens, DispatchPattern=tmatch_2)  # -> ListA, ListB
panel_6 = Panel(dispatch.ListA)
panel_7 = Panel(dispatch_2.ListA)

# ----
response_ok = Panel(rec_2)
called_tool_name = Panel(rec)

# ----
# Debug Tool Names
# This Panel should always be TRUE
tool_names_from_the_results_clusters = Data(panel_4)
tool_names_from_the_definition_clusters = Data(panel_3)
join = TextJoin(Text=flatten(tool_names_from_the_definition_clusters))
join_2 = TextJoin(Text=flatten(tool_names_from_the_results_clusters))
tstat = TreeStatistics(Tree=tool_names_from_the_definition_clusters)  # -> Paths, Length, Count
tstat_2 = TreeStatistics(Tree=tool_names_from_the_results_clusters)  # -> Paths, Length, Count
dpath = DeconstructPath(Branch=tstat.Paths)
dpath_2 = DeconstructPath(Branch=tstat_2.Paths)
equals = Equality(FirstNumber=tstat.Length, SecondNumber=tstat_2.Length)  # -> Equality, Inequality
equals_2 = Equality(FirstNumber=tstat.Count, SecondNumber=tstat_2.Count)  # -> Equality, Inequality
ma = MassAddition(Input=flatten(equals.Equality))  # -> Result, PartialResults
equals_3 = Equality(FirstNumber=dpath, SecondNumber=dpath_2)  # -> Equality, Inequality
lng = ListLength(List=equals.Equality)
ma_2 = MassAddition(Input=flatten(equals_3.Inequality))  # -> Result, PartialResults
equals_4 = Equality(FirstNumber=ma.Result, SecondNumber=lng)  # -> Equality, Inequality
does_quantity_of_tools_match = Panel(equals_2.Equality)
equals_5 = Equality(FirstNumber=ma_2.Result, SecondNumber="0")  # -> Equality, Inequality
does_quantity_of_tools_match_per_team = Panel(equals_4.Equality)
are_all_teams_included = Panel(equals_5.Equality)

tmatch_3 = MatchText(Text=join, Pattern=join_2, Case=True)

do_all_names_match = Panel(tmatch_3)
and = GateAnd(A=equals_5.Equality, B=equals_4.Equality, C=equals_2.Equality, D=tmatch_3)  # -> flatten(Result)
do_trees_match = Panel(and)

# ==== cluster Team01DefinitionCluster

panel = Panel("This tool computes the volume of a cone by giving it a radius and height.  The output unit is the input unit cubed.")
param = DefineToolParameter(Name="radius", Type="number", Description="The Radius of a Cone", Required=Toggle(True))
param_2 = DefineToolParameter(Name="height", Type="number", Description="The Height of a Cone", Required=Toggle(True))
merge = Merge(Data1=param, Data2=param_2)
tool = DefineTool(Name="compute_volume_of_cone", Description=panel, Parameters=merge)

# ----
# Team 01 Definition Cluster
# SPHERE TEAM
panel_2 = Panel("This tool computes the volume of a sphere by giving it a radius.  The output unit is the input unit cubed.")
panel_3 = Panel("This tool deletes a room by giving it a room name and the layout json")
panel_4 = Panel("This tool computes the area of a sphere by giving it a radius.  The output unit is the input unit squared.")

panel_5 = Panel("This tool computes the volume of a box by giving it a width, length and height. The output unit is the input unit cubed.")
param_3 = DefineToolParameter(Name="width", Type="number", Description="The Width of a Box", Required=Toggle(True))
param_4 = DefineToolParameter(Name="length", Type="number", Description="The Length of a Box", Required=Toggle(True))
param_5 = DefineToolParameter(Name="height", Type="number", Description="The Height of a Box", Required=Toggle(True))
merge_2 = Merge(Data1=param_3, Data2=param_4, Data3=param_5)
tool_2 = DefineTool(Name="compute_volume_of_box", Description=panel_5, Parameters=merge_2)

panel_6 = Panel("Type of building element to classify, such as core, shaft, column, structural_wall, bathroom, kitchen, partition, or furniture.")
panel_7 = Panel("Classify building elements by how difficult it is to change in a future reuse scenario.")
param_6 = DefineToolParameter(Name="element_type", Type="string", Description=panel_6, Required=Toggle(True))
tool_3 = DefineTool(Name="classify_element_permanence", Description=panel_7, Parameters=param_6)

panel_8 = Panel("This tool deletes a room by giving it a room name and the layout json")
param_7 = DefineToolParameter(Name="room_name", Type="string", Description="the name of the room", Required=Toggle(True))
param_8 = DefineToolParameter(Name="layout_json", Type="string", Description="the layout data structure", Required=Toggle(True))
param_9 = DefineToolParameter(Name="room_name", Type="string", Description="the name of the room", Required=Toggle(True))
param_10 = DefineToolParameter(Name="layout_json", Type="string", Description="the layout data structure", Required=Toggle(True))
param_11 = DefineToolParameter(Name="radius", Type="number", Description="The Radius of a Sphere", Required=Toggle(True))
param_12 = DefineToolParameter(Name="radius", Type="number", Description="The Radius of a Sphere", Required=Toggle(True))
param_13 = DefineToolParameter(Name="width", Type="number", Description="The width of the window", Required=Toggle(True))
merge_3 = Merge(Data1=param_7, Data2=param_8)
merge_4 = Merge(Data1=param_9, Data2=param_13, Data3=param_10)
tool_4 = DefineTool(Name="compute_volume_of_sphere", Description=panel_2, Parameters=param_11)
tool_5 = DefineTool(Name="compute_area_of_sphere", Description=panel_4, Parameters=param_12)
tool_6 = DefineTool(Name="delete_room_01", Description=panel_3, Parameters=merge_3)
tool_7 = DefineTool(Name="add_window_01", Description=panel_8, Parameters=merge_4)
merge_5 = Merge(Data1=tool_4, Data2=tool_5, Data3=tool_6, Data4=tool_7, Data5=tool, Data6=tool_2, Data7=tool_3)
mcp_tool_list = ClusterOutput(merge_5)
panel_9 = Panel(merge_5)

# ==== cluster Team01ResultCluster

# ----
# Team 01 Result Cluster
# SPHERE TEAM
# Edit Tool Names to
# Match Definition Cluster
tool_names = Panel("""compute_volume_of_sphere
compute_area_of_sphere
delete_room_01
add_window_01
compute_volume_of_cone
compute_volume_of_box
classify_element_permanence""")

# ----
# Sorting Logic, Please Do Not Edit
tool_call_request = ClusterInput()
tool_names_2 = Text(tool_names)
decall = DeconstructToolCall(Request=tool_call_request)  # -> Request, Tool, Arguments
mindex = MemberIndex(Set=tool_names, Member=decall.Tool)  # -> Index, Count
sift = SiftPattern(List=decall.Request, SiftPattern=mindex.Index)  # -> Output0, Output1, Output2, Output3, Output4, Output5, Output6

# ---- group: Cluster Output
tool_names_3 = ClusterOutput(tool_names_2)

# ----
panel = Panel(tool_call_request)

decall_2 = DeconstructToolCall(Request=sift.Output6)  # -> Request, Tool, Arguments
gjok = GetJSONObjectKey(JObject=decall_2.Arguments, Key="element_type")
rjv = ReadJSONValue(JValue=gjok)  # -> AsString, AsNumber, AsBool
json_value = Panel("""core 01
shaft
column
wall
shear wall
Column
WC""")
permantent_type = Panel("""shaft
core
column
structural_wall
load_bearing_wall
shear_wall""")
semi_permantent_type = Panel("""wall
bathroom
kitchen""")
flexible_type = Panel("""partition
door
window
room""")
python_3_script = Python3Script(
    json_value=rjv.AsString,
    permanent_types=permantent_type,
    semi_permanent_types=semi_permantent_type,
    flexible_types=flexible_type)  # -> out, classification, cleaned_values, matched_keyword; inputs json_value: list of String, permanent_types: list, semi_permanent_types: list, flexible_types: list
# ---------- python_3_script: Python ----------
# Inputs:
# json_value: list of element names or element types from JSON
# permanent_types: list or comma-separated text of permanent keywords
# semi_permanent_types: list or comma-separated text of semi-permanent keywords
# flexible_types: list or comma-separated text of flexible keywords

# Outputs:
# classification: permanent / semi-permanent / flexible / unknown
# cleaned_values: cleaned input values
# matched_keyword: keyword that caused the classification


def clean_text(value):
    if value is None:
        return ""
    return str(value).strip().lower().replace(" ", "_").replace("-", "_")


def force_list(value):
    if value is None:
        return []
    if isinstance(value, list):
        return value
    return [value]


def build_keyword_list(value):
    keywords = []

    for item in force_list(value):
        text = str(item)

        # Allows both:
        # one panel with "core, shaft, column"
        # OR a Grasshopper list with one item per line
        parts = text.split(",")

        for part in parts:
            cleaned = clean_text(part)
            if cleaned:
                keywords.append(cleaned)

    return keywords


def classify_element(element_type, permanent_list, semi_list, flexible_list):
    text = clean_text(element_type)

    for keyword in permanent_list:
        if keyword in text:
            return "permanent", keyword

    for keyword in semi_list:
        if keyword in text:
            return "semi-permanent", keyword

    for keyword in flexible_list:
        if keyword in text:
            return "flexible", keyword

    return "unknown", ""


permanent_list = build_keyword_list(permanent_types)
semi_list = build_keyword_list(semi_permanent_types)
flexible_list = build_keyword_list(flexible_types)

classification = []
cleaned_values = []
matched_keyword = []

for item in force_list(json_value):
    cleaned = clean_text(item)
    result, keyword = classify_element(cleaned, permanent_list, semi_list, flexible_list)

    cleaned_values.append(cleaned)
    classification.append(result)
    matched_keyword.append(keyword)
# ---------- end python_3_script ----------
panel_2 = Panel(python_3_script.classification)
panel_3 = Panel(python_3_script.cleaned_values)
panel_4 = Panel(python_3_script.matched_keyword)
cjv = CreateJSONValue(Value=python_3_script.classification)
cjo = CreateJSONObject(Keys="permanence classification", Values=cjv)
respond = MCPToolResponse(Request=decall_2.Request, Content=cjo, IsError=False)

# ---- group: Get the request sent from VSC Agent
decall_3 = DeconstructToolCall(Request=sift.Output3)  # -> Request, Tool, Arguments

# ----
decall_4 = DeconstructToolCall(Request=sift.Output2)  # -> Request, Tool, Arguments
decall_5 = DeconstructToolCall(Request=sift.Output1)  # -> Request, Tool, Arguments
decall_6 = DeconstructToolCall(Request=sift.Output0)  # -> Request, Tool, Arguments

decall_7 = DeconstructToolCall(Request=sift.Output4)  # -> Request, Tool, Arguments
gjok_2 = GetJSONObjectKey(JObject=decall_7.Arguments, Key="radius")
gjok_3 = GetJSONObjectKey(JObject=decall_7.Arguments, Key="height")
rjv_2 = ReadJSONValue(JValue=gjok_2)  # -> AsString, AsNumber, AsBool
rjv_3 = ReadJSONValue(JValue=gjok_3)  # -> AsString, AsNumber, AsBool
cone = Cone(Base=PlaneXY(0, 0, 0), Radius=rjv_2.AsNumber, Length=rjv_3.AsNumber)  # -> Cone, Tip
volume = Volume(Geometry=cone.Cone)  # -> Volume, Centroid
geo = Geometry(cone.Cone)
panel_5 = Panel(volume.Volume)
cjv_2 = CreateJSONValue(Value=panel_5)
cjo_2 = CreateJSONObject(Keys="volume", Values=cjv_2)
respond_2 = MCPToolResponse(Request=decall_7.Request, Content=cjo_2, IsError=False)

gjok_4 = GetJSONObjectKey(JObject=decall_5.Arguments, Key="radius")
gjok_5 = GetJSONObjectKey(JObject=decall_6.Arguments, Key="radius")
rjv_4 = ReadJSONValue(JValue=gjok_4)  # -> AsString, AsNumber, AsBool
rjv_5 = ReadJSONValue(JValue=gjok_5)  # -> AsString, AsNumber, AsBool

# ---- group: Extract the tool call parameters
gjok_6 = GetJSONObjectKey(JObject=decall_3.Arguments, Key="layout_json")
gjok_7 = GetJSONObjectKey(JObject=decall_3.Arguments, Key="room_name")
gjok_8 = GetJSONObjectKey(JObject=decall_3.Arguments, Key="width")
rjv_6 = ReadJSONValue(JValue=gjok_6)  # -> AsString, AsNumber, AsBool
rjv_7 = ReadJSONValue(JValue=gjok_8)  # -> AsString, AsNumber, AsBool

# ----
sph = Sphere(Base=PlaneXY(0, 0, 0), Radius=rjv_4.AsNumber)
sph_2 = Sphere(Base=PlaneXY(0, 0, 0), Radius=rjv_5.AsNumber)
gjok_9 = GetJSONObjectKey(JObject=decall_4.Arguments, Key="layout_json")
gjok_10 = GetJSONObjectKey(JObject=decall_4.Arguments, Key="room_name")
area = Area(Geometry=sph)  # -> Area, Centroid
volume_2 = Volume(Geometry=sph_2)  # -> Volume, Centroid
geo_2 = Geometry(sph_2)
geo_3 = Geometry(sph)
rjv_8 = ReadJSONValue(JValue=gjok_9)  # -> AsString, AsNumber, AsBool
panel_6 = Panel(area.Area)
panel_7 = Panel(volume_2.Volume)

# ---- group: Delete a Space by name
py3 = Python3Script(json_str=rjv_8.AsString, room_name=gjok_10)  # -> out, a; inputs room_name: String
# ---------- py3: Python ----------
import json
import copy

# Inputs:
# json_str -> JSON as string
# room_name -> e.g. "Kitchen"

def load_json_from_string(json_string):
    try:
        data = json.loads(json_string)
    except Exception as e:
        raise ValueError(f"Invalid JSON string: {e}")
    return data

# Load JSON
data = load_json_from_string(json_str)

# Work on a copy
filtered = copy.deepcopy(data)

# ------------------------
# 1. Find room IDs to remove
# ------------------------
ids_to_remove = set()

for room in filtered.get("rooms", []):
    if room.get("name") == room_name:
        ids_to_remove.add(room.get("id"))

# ------------------------
# 2. Remove from rooms
# ------------------------
filtered["rooms"] = [
    r for r in filtered.get("rooms", [])
    if r.get("id") not in ids_to_remove
]

# ------------------------
# 3. Remove / clean DOORS
# (remove doors that connect to deleted rooms)
# ------------------------
filtered["doors"] = [
    d for d in filtered.get("doors", [])
    if not any(rid in ids_to_remove for rid in d.get("attributes", {}).get("connectsRooms", []))
]

# ------------------------
# 4. Remove WINDOWS linked to deleted rooms
# ------------------------
filtered["windows"] = [
    w for w in filtered.get("windows", [])
    if w.get("attributes", {}).get("roomId") not in ids_to_remove
]

# ------------------------
# 5. Remove FURNITURE linked to deleted rooms
# ------------------------
filtered["furniture"] = [
    f for f in filtered.get("furniture", [])
    if f.get("attributes", {}).get("roomId") not in ids_to_remove
]

# ------------------------
# 6. (Optional) MEP cleanup
# (only if tied to rooms — currently not in your schema)
# ------------------------
# Keeping all MEP elements for now

# ------------------------
# 7. STRUCTURE
# (typically global, so we keep it)
# ------------------------

# ------------------------
# Output ONLY as string
# ------------------------
a = json.dumps(filtered, indent=2)
# ---------- end py3 ----------

# ---- group: Get a Specific Room
py3_2 = Python3Script(json_str=rjv_6.AsString, room_name=gjok_7)  # -> out, a; inputs room_name: String
# ---------- py3_2: Python ----------
import json
import Rhino.Geometry as rg

# Inputs:
# json_str -> JSON as string
# room_name -> e.g. "Living Room"

def load_json_from_string(json_string):
    try:
        data = json.loads(json_string)
    except Exception as e:
        raise ValueError(f"Invalid JSON string: {e}")
    return data

def create_polyline(points):
    pts = [rg.Point3d(x, y, 0) for x, y in points]

    # Ensure closed
    if pts[0] != pts[-1]:
        pts.append(pts[0])

    return rg.Polyline(pts).ToPolylineCurve()

# Load JSON
data = load_json_from_string(json_str)

# Find the room
room_curve = None

for room in data.get("rooms", []):
    if room.get("name") == room_name:
        geometry = room.get("geometry")
        if geometry:
            room_curve = create_polyline(geometry)
        break

# Output ONLY the polyline
a = room_curve
# ---------- end py3_2 ----------

# ----
cjv_3 = CreateJSONValue(Value=panel_6)
cjv_4 = CreateJSONValue(Value=panel_7)
pjs = ParseJSONString(Text=py3.a)
cjo_3 = CreateJSONObject(Keys="area", Values=cjv_3)
cjo_4 = CreateJSONObject(Keys="volume", Values=cjv_4)
respond_3 = MCPToolResponse(Request=decall_4.Request, Content=pjs, IsError=False)
respond_4 = MCPToolResponse(Request=decall_5.Request, Content=cjo_3, IsError=False)
respond_5 = MCPToolResponse(Request=decall_6.Request, Content=cjo_4, IsError=False)

decall_8 = DeconstructToolCall(Request=sift.Output5)  # -> Request, Tool, Arguments
gjok_11 = GetJSONObjectKey(JObject=decall_8.Arguments, Key="width")
gjok_12 = GetJSONObjectKey(JObject=decall_8.Arguments, Key="length")
gjok_13 = GetJSONObjectKey(JObject=decall_8.Arguments, Key="height")
rjv_9 = ReadJSONValue(JValue=gjok_11)  # -> AsString, AsNumber, AsBool
rjv_10 = ReadJSONValue(JValue=gjok_12)  # -> AsString, AsNumber, AsBool
rjv_11 = ReadJSONValue(JValue=gjok_13)  # -> AsString, AsNumber, AsBool

number = Number(rjv_9.AsNumber)
number_2 = Number(rjv_10.AsNumber)
number_3 = Number(rjv_11.AsNumber)

center_box = CenterBox(Base=PlaneXY(0, 0, 0), X=number, Y=number_2, Z=number_3)
volume_3 = Volume(Geometry=center_box)  # -> Volume, Centroid
panel_8 = Panel(volume_3.Volume)
geo_4 = Geometry(center_box)
cjv_5 = CreateJSONValue(Value=panel_8)
cjo_5 = CreateJSONObject(Keys="volume", Values=cjv_5)
respond_6 = MCPToolResponse(Request=decall_8.Request, Content=cjo_5, IsError=False)

# ---- group: Design Logic to Add a Window
room_polyline = Data(py3_2.a)
panel_9 = Panel("2")
debrep = DeconstructBrep(Brep=room_polyline)  # -> Faces, Edges, Vertices
item = ListItem(List=debrep.Edges, Index=0, Wrap=True)
midpt = CurveMiddle(Curve=item)

# ----
division = Division(A=rjv_7.AsNumber, B=panel_9)

# ---- group: Design Logic to Add a Window (continued)
X = UnitX(Factor=division)
move = Move(Geometry=midpt, Motion=expr("-x", X))  # -> Geometry, Transform
move_2 = Move(Geometry=midpt, Motion=X)  # -> Geometry, Transform
merge = Merge(Data1=move_2.Geometry, Data2=move.Geometry)

# ---- group: Creates a Window Object
txt = Text(merge)
window_object = Python3Script(element_id="window-2", name="South Window", geometry=txt)  # -> out, window_obj; inputs element_id: String, geometry: list
# ---------- window_object: Python ----------
import json

def parse_point_string(pt_str):
    """
    Converts '{3.5, 0, 0}' -> [3.5, 0.0]
    """
    # Remove braces and spaces
    cleaned = pt_str.strip().replace("{", "").replace("}", "")
    
    # Split into components
    parts = cleaned.split(",")
    
    if len(parts) < 2:
        raise ValueError(f"Invalid point format: {pt_str}")
    
    x = float(parts[0])
    y = float(parts[1])
    
    return [x, y]

def serialize_geometry(geometry_list):
    """
    Converts list of GH strings into [[x,y], [x,y]]
    """
    return [parse_point_string(pt) for pt in geometry_list]

# ------------------------
# Convert geometry
# ------------------------
serialized_geometry = serialize_geometry(geometry)

# Build window object
window_obj = {
    "id": element_id,
    "name": name,
    "geometry": serialized_geometry
}

# Optional attributes
if attributes:
    window_obj["attributes"] = attributes

# Output ONLY as JSON string
window_obj = json.dumps(window_obj, indent=2)
# ---------- end window_object ----------

# ---- group: Merge it to the original layout json
py3_3 = Python3Script(json_str=rjv_6.AsString, new_object=window_object.window_obj)  # -> out, updated_layout
# ---------- py3_3: Python ----------
import json
import copy

def load_json_from_string(json_string):
    try:
        return json.loads(json_string)
    except Exception as e:
        raise ValueError(f"Invalid JSON string: {e}")

def detect_object_type(obj):
    """
    Infer target list from object id prefix.
    """
    obj_id = obj.get("id", "").lower()

    if obj_id.startswith("window"):
        return "windows"
    elif obj_id.startswith("door"):
        return "doors"
    elif obj_id.startswith("furn") or obj_id.startswith("furniture"):
        return "furniture"
    elif obj_id.startswith("mep"):
        return "mep"
    elif obj_id.startswith("wall") or obj_id.startswith("structure"):
        return "structure"
    else:
        # default fallback (safe choice)
        return "windows"

# ------------------------
# Load inputs
# ------------------------
layout = load_json_from_string(json_str)
new_object = json.loads(new_object)  # assuming object comes as JSON string

# Work on copy
updated = copy.deepcopy(layout)

# ------------------------
# Detect target category
# ------------------------
target_key = detect_object_type(new_object)

# ------------------------
# Ensure list exists
# ------------------------
if target_key not in updated:
    updated[target_key] = []

# ------------------------
# Insert object
# ------------------------
updated[target_key].append(new_object)

# ------------------------
# Output JSON string
# ------------------------
updated_layout = json.dumps(updated, indent=2)
# ---------- end py3_3 ----------

# ----
pjs_2 = ParseJSONString(Text=py3_3.updated_layout)
respond_7 = MCPToolResponse(Request=decall_3.Request, Content=pjs_2, IsError=False)
merge_2 = Merge(Data1=flatten(py3.a), Data2=flatten(py3_3.updated_layout))
or = GateOr(A=respond_5, B=respond_4, C=respond_3, D=respond_7, E=respond_2, F=respond_6, G=respond)
tool_call_success = ClusterOutput(or)

# ---- group: Extractor Tool do map json to grasshopper data
extractor = Python3Script(json_str=merge_2)  # -> out, outline_curve, room_names, room_curves, door_names, door_curves, window_names, window_curves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
# ---------- extractor: Python ----------
import json
import Rhino.Geometry as rg

def load_json_from_string(json_string):
    try:
        data = json.loads(json_string)
    except Exception as e:
        raise ValueError(f"Invalid JSON string: {e}")
    return data

def create_polyline(points, close=True):
    """Create a Rhino PolylineCurve from 2D points"""
    pts = [rg.Point3d(x, y, 0) for x, y in points]

    if close and pts[0] != pts[-1]:
        pts.append(pts[0])

    return rg.Polyline(pts).ToPolylineCurve()

def create_line(points):
    """Create a Rhino LineCurve from 2 points"""
    if len(points) != 2:
        return None
    p1 = rg.Point3d(points[0][0], points[0][1], 0)
    p2 = rg.Point3d(points[1][0], points[1][1], 0)
    return rg.LineCurve(p1, p2)

# Load JSON
layout = load_json_from_string(json_str)

# ------------------------
# ROOMS (polygons)
# ------------------------
room_names = []
room_curves = []

for room in layout.get("rooms", []):
    name = room.get("name")
    geometry = room.get("geometry")

    if name and geometry:
        curve = create_polyline(geometry, close=True)
        room_names.append(name)
        room_curves.append(curve)

# ------------------------
# DOORS (lines)
# ------------------------
door_names = []
door_curves = []

for door in layout.get("doors", []):
    name = door.get("name")
    geometry = door.get("geometry")

    if name and geometry:
        curve = create_line(geometry)
        if curve:
            door_names.append(name)
            door_curves.append(curve)

# ------------------------
# WINDOWS (lines)
# ------------------------
window_names = []
window_curves = []

for window in layout.get("windows", []):
    name = window.get("name")
    geometry = window.get("geometry")

    if name and geometry:
        curve = create_line(geometry)
        if curve:
            window_names.append(name)
            window_curves.append(curve)

# ------------------------
# FURNITURE (polygons)
# ------------------------
furniture_names = []
furniture_curves = []

for furn in layout.get("furniture", []):
    name = furn.get("name")
    geometry = furn.get("geometry")

    if name and geometry:
        curve = create_polyline(geometry, close=True)
        furniture_names.append(name)
        furniture_curves.append(curve)

# ------------------------
# MEP (polygons)
# ------------------------
mep_names = []
mep_curves = []

for m in layout.get("mep", []):
    name = m.get("name")
    geometry = m.get("geometry")

    if name and geometry:
        curve = create_polyline(geometry, close=True)
        mep_names.append(name)
        mep_curves.append(curve)

# ------------------------
# STRUCTURE (lines)
# ------------------------
structure_names = []
structure_curves = []

for s in layout.get("structure", []):
    name = s.get("name")
    geometry = s.get("geometry")

    if name and geometry:
        curve = create_line(geometry)
        if curve:
            structure_names.append(name)
            structure_curves.append(curve)

# ------------------------
# OUTLINE (optional)
# ------------------------
outline_curve = None
if "outline" in layout:
    outline_curve = create_polyline(layout["outline"], close=True)

# ------------------------
# OUTPUTS
# ------------------------
a = room_names
b = room_curves

c = door_names
d = door_curves

e = window_names
f = window_curves

g = furniture_names
h = furniture_curves

i = mep_names
j = mep_curves

k = structure_names
l = structure_curves

m = outline_curve
# ---------- end extractor ----------

# ---- group: Polylines
srf = Surface(extractor.room_curves)
preview = CustomPreview(Geometry=srf, Material=[ColourSwatch(SwatchColor=RGB(167, 219, 44)), ColourSwatch(SwatchColor=RGB(4, 154, 184))])

# ---- group: Windows
data = Data(extractor.window_curves)
previewlw = CustomPreviewLineweights(Geometry=data, Shader=ColourSwatch(SwatchColor=RGB(56, 56, 56)), Thickness=Slider(5.4, range=0..10), Absolute=False)

# ---- group: Labels
area_2 = Area(Geometry=srf)  # -> Area, Centroid
tag = TextTag(Location=area_2.Centroid, Text=extractor.room_names)
